# Grasshopper definition GSA Model Generation.gh (Grasshopper 1.0.8)
# plug-ins: Karamba3D, GSA

series = Series(Start=0, Step=1, Count=10)
pt = ConstructPoint(XCoordinate=series, YCoordinate=0, ZCoordinate=0)
yz = YZPlane(Origin=pt)
rectangle = Rectangle(Plane=PlaneXY(0, 0, 0), XSize="-100 to 100", YSize="-100 to 100", Radius=0)  # -> Rectangle, Length
cir = Circle(Plane=yz, Radius=1)
split = SplitWithBrep(Curve=cir, Brep=rectangle.Rectangle)  # -> Curve, Points
item = ListItem(List=split.Curve, Index=0, Wrap=True)  # -> flatten(Item)
loft = Loft(Curves=item, Options={Adjust=False, Closed=False, LoftEnds=0, LoftSimp=0, LoftType=0, Rebuild=10, Refit=0.01})
mesh_uv = MeshSurface(Surface=loft, UCount="50", VCount="25", Overhang=True, Equalize=False)
xz = XZPlane(Origin=Point(0, 0, 0))
rectangle_2 = Rectangle(Plane=PlaneXY(0, 0, 0), XSize="-5 to 5", YSize="-5 to 5", Radius=0)  # -> Rectangle, Length
rectangle_3 = Rectangle(Plane=xz, XSize="-5 to 5", YSize="-5 to 5", Radius=0)  # -> Rectangle, Length
panel = Panel("25")
mesh_uv_2 = MeshSurface(Surface=rectangle_2.Rectangle, UCount="50", VCount="50", Overhang=True, Equalize=False)
mesh_uv_3 = MeshSurface(Surface=rectangle_3.Rectangle, UCount="50", VCount="50", Overhang=True, Equalize=False)
mat = CreateMaterial(Material_type="Steel", Design_Code="EN 1993-1-1:2005", Grade="S355")
mat_2 = CreateMaterial(Material_type="Steel", Design_Code="EN 1993-1-1:2005", Grade="S355")
explode = Explode(Curve=rectangle_2.Rectangle, Recursive=True)  # -> Segments, Vertices
rdpoints = RemoveDuplicatePointsKaramba3D(Point=explode.Vertices, LimitDistance=0.005)  # -> OutPoint, Info, Indexes
explode_2 = Explode(Curve=rectangle_3.Rectangle, Recursive=True)  # -> Segments, Vertices
prop2d = Create2DProperty(Thickness_cm="2", Material=mat, Type="Shell", Unit="cm")
rdpoints_2 = RemoveDuplicatePointsKaramba3D(Point=explode_2.Vertices, LimitDistance=0.005)  # -> OutPoint, Info, Indexes
loadcase = CreateLoadCase(CaseID="1", Name="DL", Type="Dead")
prop2d_2 = Create2DProperty(Thickness_cm="2", Material=mat_2, Type="Shell", Unit="cm")
support = CreateSupport(Point=rdpoints.OutPoint, Plane=PlaneXY(0, 0, 0), x=True, xx=False, y=True, yy=False, z=True, zz=False)
loadcase_2 = CreateLoadCase(CaseID="1", Name="DL", Type="Dead")
support_2 = CreateSupport(Point=rdpoints_2.OutPoint, Plane=PlaneXY(0, 0, 0), x=True, xx=False, y=True, yy=False, z=True, zz=False)
elem2d = Create2DElement(Geometry=mesh_uv_2, Property2D=prop2d, Preview3dSection=False)
faceload = CreateFaceLoad(
    LoadCase=loadcase,
    Loadable2DObjects=elem2d,
    Axis=-1,
    Direction="z",
    Projected=False,
    Value_kN_m²="-1",
    Type="Uniform",
    Unit="kN/m²")
σt = CreateAnalysisTask(Name="LC1", casesParamIndex=2, Solver="Static")
elem2d_2 = Create2DElement(Geometry=mesh_uv_3, Property2D=prop2d_2, Preview3dSection=False)
faceload_2 = CreateFaceLoad(
    LoadCase=loadcase_2,
    Loadable2DObjects=elem2d_2,
    Axis=-1,
    Direction="z",
    Projected=False,
    Value_kN_m²="-1",
    Type="Uniform",
    Unit="kN/m²")
σt_2 = CreateAnalysisTask(casesParamIndex=2, Solver="Static")
model = CreateModel(
    GSAGeometryIn_m=flatten([support, elem2d]),
    Load=faceload,
    AnalysisTasksCombinations=σt,
    ReMesh=True,
    Tolerance=0.01,
    Unit="m")
model_2 = CreateModel(
    GSAGeometryIn_m=flatten([support_2, elem2d_2]),
    Load=faceload_2,
    AnalysisTasksCombinations=σt_2,
    ReMesh=True,
    Tolerance=0.01,
    Unit="m")
panel_2 = Panel("C:\Users\Matt C\Documents\GitHub\PrincipalStressLines\Example Files\GSA  Model.gwb")
save = Button()
save_2 = SaveGSAModel(GSAModel=model_2, Save=save, FileAndPath=panel_2)
